# Grasshopper definition assignment-01.gh (Grasshopper 1.0.8)

# ---- group: basic_background
# Assignment-01: Bauhaus
base_point_x = Slider(-83.056, range=-1000..1)
base_point_y = Slider(-702.955, range=-1000..1)
base_point_z = Slider(-1, range=-1..1)
length_input = Slider(1080.644, range=0.1..10000)
width_input = Slider(1014.675, range=0.1..10000)
height_input = Slider(1, range=0.1..20)
pt = ConstructPoint(XCoordinate=base_point_x, YCoordinate=base_point_y, ZCoordinate=base_point_z)
cube = Python3Script(base_point=pt, length=length_input, width=width_input, height=height_input)  # -> out, my_cube; inputs base_point: Point3d
# ---------- cube: Python ----------
from cdf import create_cube
my_cube = create_cube(base_point, length, width, height)

print("length:", length)
print("width:", width)
print("height:", height)
# ---------- end cube ----------
preview = CustomPreview(Geometry=cube.my_cube, Material=ColourSwatch(SwatchColor=RGB(205, 214, 174)))

# ---- group: basic_brep_a
base_point_x_2 = Slider(0, range=0..100)
base_point_y_2 = Slider(0, range=0..100)
base_point_z_2 = Slider(0, range=0..1)
base_point_x_3 = Slider(2.5, range=0..50)
base_point_y_3 = Slider(2.5, range=0..50)
base_point_z_3 = Slider(40, range=0..100)
base_point_x_4 = Slider(10, range=0..20)
base_point_y_4 = Slider(-15, range=-100..20)
base_point_z_4 = Slider(-2, range=-2..100)
base_point_x_5 = Slider(10, range=0..50)
base_point_z_5 = Slider(60, range=0..100)
base_point_x_6 = Slider(10, range=0..20)
base_point_y_5 = Slider(10, range=0..20)
base_point_z_6 = Slider(34.268, range=0..50)
base_point_x_7 = Slider(15, range=0..20)
base_point_y_6 = Slider(10, range=-100..20)
base_point_y_7 = Slider(10, range=0..50)
base_point_z_7 = Slider(-24.109, range=-100..100)
length_input_2 = Slider(20, range=0.1..400)
width_input_2 = Slider(20, range=0.1..400)
height_input_2 = Slider(40, range=0.1..400)
length_input_3 = Slider(15, range=0.1..400)
width_input_3 = Slider(15, range=0.1..400)
height_input_3 = Slider(20, range=0.1..400)
radius_input = Slider(5, range=0.1..20)
height_input_4 = Slider(30, range=0.1..30)
radius_input_2 = Slider(7.5, range=0.1..20)
radius_input_3 = Slider(15.139, range=0.1..20)
radius_input_4 = Slider(5.488, range=0.1..20)
radius_input_5 = Slider(5, range=0.1..20)
height_input_5 = Slider(30, range=0.1..30)
pt_2 = ConstructPoint(XCoordinate=base_point_x_2, YCoordinate=base_point_y_2, ZCoordinate=base_point_z_2)
pt_3 = ConstructPoint(XCoordinate=base_point_x_3, YCoordinate=base_point_y_3, ZCoordinate=base_point_z_3)
pt_4 = ConstructPoint(XCoordinate=base_point_x_4, YCoordinate=base_point_y_4, ZCoordinate=base_point_z_4)
pt_5 = ConstructPoint(XCoordinate=base_point_x_7, YCoordinate=base_point_y_6, ZCoordinate=base_point_z_7)
pt_6 = ConstructPoint(XCoordinate=base_point_x_5, YCoordinate=base_point_y_7, ZCoordinate=base_point_z_5)
pt_7 = ConstructPoint(XCoordinate=base_point_x_6, YCoordinate=base_point_y_5, ZCoordinate=base_point_z_6)
cube_2 = Python3Script(base_point=pt_2, length=length_input_2, width=width_input_2, height=height_input_2)  # -> out, my_cube; inputs base_point: Point3d; same code as cube
cube_3 = Python3Script(base_point=pt_3, length=length_input_3, width=width_input_3, height=height_input_3)  # -> out, my_cube; inputs base_point: Point3d; same code as cube
cylinder = Python3Script(base_point=pt_4, radius=radius_input, height=height_input_4)  # -> out, my_cylinder; inputs base_point: Point3d
# ---------- cylinder: Python ----------
from cdf import create_cylinder
my_cylinder = create_cylinder(base_point, height, radius)
# ---------- end cylinder ----------
sphere = Python3Script(center_point=pt_6, radius=radius_input_2)  # -> out, my_sphere; inputs center_point: Point3d
# ---------- sphere: Python ----------
from cdf import create_sphere
my_sphere = create_sphere(center_point, radius)
# ---------- end sphere ----------
torus = Python3Script(center_point=pt_7, major_radius=radius_input_3, minor_radius=radius_input_4)  # -> out, my_torus; inputs center_point: Point3d
# ---------- torus: Python ----------
from cdf import create_torus
my_torus = create_torus(center_point, major_radius, minor_radius)
# ---------- end torus ----------
cylinder_2 = Python3Script(base_point=pt_5, radius=radius_input_5, height=height_input_5)  # -> out, my_cylinder; inputs base_point: Point3d; same code as cylinder
preview_2 = CustomPreview(Geometry=cube_2.my_cube, Material=ColourSwatch(SwatchColor=RGB(140, 64, 31)))
preview_3 = CustomPreview(Geometry=cube_3.my_cube, Material=ColourSwatch(SwatchColor=RGB(140, 64, 31)))
preview_4 = CustomPreview(Geometry=cylinder.my_cylinder, Material=ColourSwatch(SwatchColor=RGB(103, 194, 224)))
preview_5 = CustomPreview(Geometry=sphere.my_sphere, Material=ColourSwatch(SwatchColor=RGB(25, 88, 156)))
preview_6 = CustomPreview(Geometry=torus.my_torus, Material=ColourSwatch(SwatchColor=RGB(39, 133, 232)))
preview_7 = CustomPreview(Geometry=cylinder_2.my_cylinder, Material=ColourSwatch(SwatchColor=RGB(103, 194, 224)))
base_point_x_8 = Slider(5, range=0..50)
base_point_y_8 = Slider(-5.657, range=-10..50)
base_point_z_8 = Slider(0, range=0..1)
base_point_x_9 = Slider(-5.686, range=-10..50)
base_point_y_9 = Slider(5, range=-10..50)
base_point_z_9 = Slider(0, range=0..1)
length_input_4 = Slider(10, range=0.1..400)
width_input_4 = Slider(30, range=0.1..400)
height_input_6 = Slider(15, range=0.1..20)
length_input_5 = Slider(30, range=0.1..400)
height_input_7 = Slider(15, range=0.1..20)
width_input_5 = Slider(10, range=0.1..400)
vector_xyz = VectorXYZ(XComponent=Slider(1, range=-1..1), YComponent=Slider(0, range=-1..1), ZComponent=Slider(0, range=-1..1))  # -> Vector, Length
vector_xyz_2 = VectorXYZ(XComponent=Slider(0, range=-1..1), YComponent=Slider(1, range=-1..1), ZComponent=Slider(0, range=-1..1))  # -> Vector, Length
pt_8 = ConstructPoint(XCoordinate=base_point_x_8, YCoordinate=base_point_y_8, ZCoordinate=base_point_z_8)
pt_9 = ConstructPoint(XCoordinate=base_point_x_9, YCoordinate=base_point_y_9, ZCoordinate=base_point_z_9)
rotate_brep = Python3Script(brep=cylinder.my_cylinder, angle_degrees=Slider(270, range=0..360), axis_direction=vector_xyz.Vector)  # -> out, rotated_brep; inputs brep: Brep, angle_degrees: Double, axis_point: Point3d, axis_direction: Vector3d
# ---------- rotate_brep: Python ----------
from cdf import rotate_brep

rotated_brep = rotate_brep(brep, angle_degrees, axis_point, axis_direction)
# ---------- end rotate_brep ----------
rotate_brep_2 = Python3Script(brep=cylinder_2.my_cylinder, angle_degrees=Slider(270, range=0..360), axis_direction=vector_xyz_2.Vector)  # -> out, rotated_brep; inputs brep: Brep, angle_degrees: Double, axis_point: Point3d, axis_direction: Vector3d; same code as rotate_brep
cube_4 = Python3Script(base_point=pt_8, length=length_input_4, width=width_input_4, height=height_input_6)  # -> out, my_cube; inputs base_point: Point3d; same code as cube
cube_5 = Python3Script(base_point=pt_9, length=length_input_5, width=width_input_5, height=height_input_7)  # -> out, my_cube; inputs base_point: Point3d; same code as cube
boolean_difference = Python3Script(brep_a=cube_2.my_cube, brep_b=torus.my_torus)  # -> out, new_brep; inputs brep_a: Brep, brep_b: Brep
# ---------- boolean_difference: Python ----------
from cdf import boolean_difference
new_brep = boolean_difference(brep_a, brep_b)
# ---------- end boolean_difference ----------
boolean_union = Python3Script(brep_a=cube_3.my_cube, brep_b=boolean_difference.new_brep)  # -> out, new_brep; inputs brep_a: Brep, brep_b: Brep
# ---------- boolean_union: Python ----------
from cdf import boolean_union
new_brep = boolean_union(brep_a, brep_b)
# ---------- end boolean_union ----------
preview_8 = CustomPreview(Geometry=boolean_difference.new_brep, Material=ColourSwatch(SwatchColor=RGB(143, 135, 255)))
preview_9 = CustomPreview(Geometry=boolean_union.new_brep, Material=ColourSwatch(SwatchColor=RGB(143, 135, 255)))
preview_10 = CustomPreview(Geometry=rotate_brep.rotated_brep, Material=ColourSwatch(SwatchColor=RGB(60, 224, 230)))
preview_11 = CustomPreview(Geometry=cube_4.my_cube, Material=ColourSwatch(SwatchColor=RGB(159, 202, 227)))
preview_12 = CustomPreview(Geometry=rotate_brep_2.rotated_brep, Material=ColourSwatch(SwatchColor=RGB(61, 138, 134)))
preview_13 = CustomPreview(Geometry=cube_5.my_cube, Material=ColourSwatch(SwatchColor=RGB(159, 202, 227)))
boolean_union_2 = Python3Script(brep_a=rotate_brep.rotated_brep, brep_b=rotate_brep_2.rotated_brep)  # -> out, new_brep; inputs brep_a: Brep, brep_b: Brep; same code as boolean_union
boolean_union_3 = Python3Script(brep_a=cube_4.my_cube, brep_b=cube_5.my_cube)  # -> out, new_brep; inputs brep_a: Brep, brep_b: Brep; same code as boolean_union
preview_14 = CustomPreview(Geometry=boolean_union_2.new_brep, Material=ColourSwatch(SwatchColor=RGB(143, 135, 255)))
preview_15 = CustomPreview(Geometry=boolean_union_3.new_brep, Material=ColourSwatch(SwatchColor=RGB(143, 135, 255)))
boolean_union_4 = Python3Script(brep_a=boolean_union.new_brep, brep_b=sphere.my_sphere)  # -> out, new_brep; inputs brep_a: Brep, brep_b: Brep; same code as boolean_union
boolean_union_5 = Python3Script(brep_a=boolean_union_2.new_brep, brep_b=boolean_union_3.new_brep)  # -> out, new_brep; inputs brep_a: Brep, brep_b: Brep; same code as boolean_union
preview_16 = CustomPreview(Geometry=boolean_union_4.new_brep, Material=ColourSwatch(SwatchColor=RGB(143, 135, 255)))
preview_17 = CustomPreview(Geometry=boolean_union_5.new_brep, Material=ColourSwatch(SwatchColor=RGB(143, 135, 255)))
boolean_difference_2 = Python3Script(brep_a=boolean_union_4.new_brep, brep_b=boolean_union_5.new_brep)  # -> out, new_brep; inputs brep_a: Brep, brep_b: Brep; same code as boolean_difference
preview_18 = CustomPreview(Geometry=boolean_difference_2.new_brep, Material=ColourSwatch(SwatchColor=RGB(168, 141, 91)))

# ---- group: basic_brep_b
base_point_y_10 = Slider(5, range=0..100)
base_point_z_10 = Slider(10, range=0..100)
base_point_x_10 = Slider(55, range=0..100)
base_point_x_11 = Slider(50, range=0..100)
base_point_y_11 = Slider(0, range=0..100)
base_point_z_11 = Slider(0, range=0..1)
base_point_z_12 = Slider(20, range=0..100)
base_point_x_12 = Slider(60, range=0..100)
base_point_y_12 = Slider(10, range=0..100)
length_input_6 = Slider(20, range=0.1..400)
width_input_6 = Slider(20, range=0.1..400)
height_input_8 = Slider(10, range=0.1..400)
length_input_7 = Slider(30, range=0.1..400)
width_input_7 = Slider(30, range=0.1..400)
height_input_9 = Slider(10, range=0.1..400)
length_input_8 = Slider(10, range=0.1..400)
width_input_8 = Slider(10, range=0.1..400)
height_input_10 = Slider(20, range=0.1..400)
pt_10 = ConstructPoint(XCoordinate=base_point_x_10, YCoordinate=base_point_y_10, ZCoordinate=base_point_z_10)
pt_11 = ConstructPoint(XCoordinate=base_point_x_11, YCoordinate=base_point_y_11, ZCoordinate=base_point_z_11)
pt_12 = ConstructPoint(XCoordinate=base_point_x_12, YCoordinate=base_point_y_12, ZCoordinate=base_point_z_12)
cube_6 = Python3Script(base_point=pt_11, length=length_input_7, width=width_input_7, height=height_input_9)  # -> out, my_cube; inputs base_point: Point3d; same code as cube
cube_7 = Python3Script(base_point=pt_10, length=length_input_6, width=width_input_6, height=height_input_8)  # -> out, my_cube; inputs base_point: Point3d; same code as cube
cube_8 = Python3Script(base_point=pt_12, length=length_input_8, width=width_input_8, height=height_input_10)  # -> out, my_cube; inputs base_point: Point3d; same code as cube
boolean_union_6 = Python3Script(brep_a=cube_6.my_cube, brep_b=cube_7.my_cube)  # -> out, new_brep; inputs brep_a: Brep, brep_b: Brep; same code as boolean_union
preview_19 = CustomPreview(Geometry=boolean_union_6.new_brep, Material=ColourSwatch(SwatchColor=RGB(143, 135, 255)))
boolean_union_7 = Python3Script(brep_a=boolean_union_6.new_brep, brep_b=cube_8.my_cube)  # -> out, new_brep; inputs brep_a: Brep, brep_b: Brep; same code as boolean_union
preview_20 = CustomPreview(Geometry=boolean_union_7.new_brep, Material=ColourSwatch(SwatchColor=RGB(240, 217, 163)))

# ---- group: basic_brep_c
base_point_x_13 = Slider(129.923, range=0..200)
base_point_y_13 = Slider(-20, range=-100..100)
base_point_z_13 = Slider(40, range=0..100)
height = Slider(40, range=0.1..400)
radius = Slider(15, range=0.1..400)
pt_13 = ConstructPoint(XCoordinate=base_point_x_13, YCoordinate=base_point_y_13, ZCoordinate=base_point_z_13)
cone = Python3Script(base_point=pt_13, height=height, radius=radius)  # -> out, my_cone; inputs base_point: Point3d
# ---------- cone: Python ----------
from cdf import create_cone
my_cone = create_cone(base_point, height, radius)
# ---------- end cone ----------
number_slider = Slider(180, range=0..360)
construct_point = ConstructPoint(XCoordinate=0, YCoordinate=0, ZCoordinate=Slider(40, range=-1..100))
vector_xyz_3 = VectorXYZ(XComponent=Slider(1, range=-1..1), YComponent=Slider(0, range=-1..1), ZComponent=Slider(0, range=-1..1))  # -> Vector, Length
rotate_brep_3 = Python3Script(brep=cone.my_cone, angle_degrees=number_slider, axis_point=construct_point, axis_direction=vector_xyz_3.Vector)  # -> out, rotated_brep; inputs brep: Brep, angle_degrees: Double, axis_point: Point3d, axis_direction: Vector3d; same code as rotate_brep
preview_21 = CustomPreview(Geometry=rotate_brep_3.rotated_brep, Material=ColourSwatch(SwatchColor=RGB(61, 138, 134)))

# ---- group: Auto-reloads cdf module on VScode changes
# Setting path for Src AutoReloader: 1. Right click on Path
# 2. Choose "Select a directory"
# 3. Locate the ..\cdf1_teaching\src folder in your computer
path = FilePath("C:\D\TUM\s3\Computational Design and Fabrication I\workspace\cdf1_teaching\src\")
autoreloader = Python3Script(src_path=path)  # -> out; inputs src_path: String
# ---------- autoreloader: Python ----------
#! python3
import sys, os, time
import scriptcontext as sc
import Rhino, System
from System.IO import FileSystemWatcher, NotifyFilters

VERSION = 1  
pkg = "cdf"

if not src_path:
    raise Exception("Connect a folder to src_path.")
path = os.path.normpath(src_path)
watch_dir = os.path.join(path, pkg)
if not os.path.isdir(watch_dir):
    raise Exception("No '{}' folder found in:\n{}".format(pkg, path))

def unload():
    for name in list(sys.modules):
        if name == pkg or name.startswith(pkg + "."):
            del sys.modules[name]

# Put this folder first in Python's search list
if path in sys.path:
    sys.path.remove(path)
sys.path.insert(0, path)

key = "cdf_watcher_" + str(ghenv.Component.InstanceGuid)
time_key = key + "_time"
version_key = key + "_version"

def stamp():
    sc.sticky[time_key] = time.strftime("%Y-%m-%d %H:%M:%S")

# Replace the old watcher if the folder changed or the script was updated
old = sc.sticky.get(key)
if old is not None and (os.path.normpath(old.Path) != watch_dir
                        or sc.sticky.get(version_key) != VERSION):
    old.Dispose()
    del sc.sticky[key]
    unload()

if key not in sc.sticky:
    comp = ghenv.Component
    last = [0.0]

    def reload_and_rerun():
        unload()
        stamp()
        doc = comp.OnPingDocument()
        if doc is None:            # reloader was deleted or the file closed
            return
        for obj in doc.Objects:
            if "Python" in obj.GetType().Name:
                obj.ExpireSolution(False)   # mark as out of date
        doc.NewSolution(False)              # recompute once

    def on_change(sender, e):
        if not e.FullPath.endswith(".py") or "__pycache__" in e.FullPath:
            return
        if time.time() - last[0] < 0.5:     # ignore the second event of a double save
            return
        last[0] = time.time()
        Rhino.RhinoApp.InvokeOnUiThread(System.Action(reload_and_rerun))

    w = FileSystemWatcher(watch_dir, "*.py")
    w.IncludeSubdirectories = True
    w.NotifyFilter = NotifyFilters.LastWrite
    w.Changed += on_change
    w.EnableRaisingEvents = True
    sc.sticky[key] = w
    sc.sticky[version_key] = VERSION
    stamp()                                  # time the watcher started

msg = "Last reloaded: {}\nWatching: {}".format(sc.sticky.get(time_key, "unknown"), watch_dir)
print(msg)
out = msg
# ---------- end autoreloader ----------
panel = Panel(autoreloader)

# ---- group: random_path
random_path = Python3Script(
    width=Slider(14, range=0..100),
    max_length=Slider(100, range=0..100),
    steps=Slider(149, range=1..200),
    angle_step=Slider(45, range=0..90),
    max_turn=Slider(90, range=0..90),
    seed=Slider(20, range=0..100))  # -> out, road_parts, centerline, info
# ---------- random_path: Python ----------
from cdf import create_random_path

road_parts, centerline, info = create_random_path(width=width, max_length=max_length, steps=steps, angle_step=angle_step, max_turn=max_turn, seed=seed)
# ---------- end random_path ----------
panel_2 = Panel(random_path.road_parts)
panel_3 = Panel(random_path.info)
preview_22 = CustomPreview(Geometry=random_path.road_parts, Material=ColourSwatch(SwatchColor=RGB(108, 112, 130)))

# ---- group: random_brep_cloud
# Note for path angle settings: 1. Straight Path
# angle_step = 90 | max_turn = 0 Allowed turns: 0°
# 2. Right-Angle Path
# angle_step = 90 | max_turn = 90 Allowed turns: -90°, 0°, +90°
# 3. Diagonal Path
#  angle_step = 45 | max_turn = 90 Allowed turns: -90°, -45°, 0°, +45°, +90°
# 4. Small-Angle Bends
# angle_step = 15 | max_turn = 60 Allowed turns: -60° to +60° in 15° increments
rotate_brep_4 = Python3Script(brep=cone.my_cone, angle_degrees=number_slider, axis_point=construct_point, axis_direction=vector_xyz_3.Vector)  # -> out, rotated_brep; inputs brep: Brep, angle_degrees: Double, axis_point: Point3d, axis_direction: Vector3d; same code as rotate_brep
boolean_difference_3 = Python3Script(brep_a=boolean_union_4.new_brep, brep_b=boolean_union_5.new_brep)  # -> out, new_brep; inputs brep_a: Brep, brep_b: Brep; same code as boolean_difference
boolean_union_8 = Python3Script(brep_a=boolean_union_6.new_brep, brep_b=cube_8.my_cube)  # -> out, new_brep; inputs brep_a: Brep, brep_b: Brep; same code as boolean_union
brep_cloud = Python3Script(
    brep_a=boolean_difference_3.new_brep,
    brep_b=boolean_union_8.new_brep,
    brep_c=rotate_brep_4.rotated_brep,
    length=Slider(933.946, range=-2000..2000),
    width=Slider(-594.726, range=-2000..2000),
    count=Slider(84, range=0..200),
    spacing_x=Slider(40, range=0..200),
    spacing_y=Slider(40, range=0..200),
    seed=Slider(162, range=0..200))  # -> out, copies_a, copies_b, copies_c, points, info; inputs brep_a: Brep, brep_b: Brep, brep_c: Brep
# ---------- brep_cloud: Python ----------
from cdf import create_brep_cloud

copies_a, copies_b, copies_c, points = create_brep_cloud(
    brep_a, brep_b, brep_c,
    length, width, count,
    spacing_x, spacing_y,
    seed
)
# ---------- end brep_cloud ----------
preview_23 = CustomPreview(Geometry=brep_cloud.copies_a, Material=ColourSwatch(SwatchColor=RGB(237, 181, 76)))

# ----
preview_24 = CustomPreview(Geometry=brep_cloud.copies_b, Material=ColourSwatch(SwatchColor=RGB(240, 217, 163)))
preview_25 = CustomPreview(Geometry=brep_cloud.copies_c, Material=ColourSwatch(SwatchColor=RGB(189, 230, 101)))
