# Grasshopper definition geometry_basics.ghx (Grasshopper 1.0.8)

radius_sphere = Slider(1, range=0..5)
_0 = Relay()  # disabled
_0_2 = Relay()
_0_3 = Relay()

# ---- group: Example: Build a Parametric Cone
pt = Point(Point(-0.4439523925, 0.05137995213, 0))
cone = Python3Script(pt=pt, h=Slider(1, range=1..10), r=Slider(1, range=1..10))  # -> out, my_cone; inputs pt: Point3d
# ---------- cone: Python ----------
# import function
from cdf import create_cone

# call function
my_cone = create_cone(base_point=pt, height=h, radius=r)
# ---------- end cone ----------

# ---- group: Auto-reloads cdf module on VScode changes
# Setting path for Src AutoReloader: 1. Right click on Path
# 2. Choose "Select a directory"
# 3. Locate the ..\cdf1_teaching\src folder in your computer
# NOTES:
# 
# - Use Python 3 Script blocks for your functions.
# - Import your functions and classes as: from cdf import my_function, My_class
# - Don't forget to add and name your INPUT and OUTPUT parameters that match your functions correctly. If you zoom in to the Python component you will see the + sign to add and - to remove them.
# - You need to attach the accurate components to your INPUT parameters: sliders for integers or floats, toggles or buttons for booleans, text for strings, Rhino geometries etc. etc.
# - If an INPUT is  a list, you need to right-click the parameter to set it as LIST access. Sometimes you need to also set the type of the INPUT by clicking TYPE HINT and selecting the correct input type.
# - If you want to hide an object, right-click component and uncheck Preview. To visualize again, check Preview.
# - If you get errors, READ THEM! They often tell what's wrong in a simple language. If not, copy-paste to CoPilot and don't be afraid to play around!
# 
# For more Grasshopper Help, go to:
# https://developer.rhino3d.com/guides/scripting/scripting-component/#script-inputs-and-outputs
path = FilePath("C:\D\TUM\s3\Computational Design and Fabrication I\workspace\cdf1_teaching\src\")
autoreloader = Python3Script(src_path=path)  # -> out; inputs src_path: String
# ---------- autoreloader: Python ----------
#! python3
import sys, os, time
import scriptcontext as sc
import Rhino, System
from System.IO import FileSystemWatcher, NotifyFilters

VERSION = 1  
pkg = "cdf"

if not src_path:
    raise Exception("Connect a folder to src_path.")
path = os.path.normpath(src_path)
watch_dir = os.path.join(path, pkg)
if not os.path.isdir(watch_dir):
    raise Exception("No '{}' folder found in:\n{}".format(pkg, path))

def unload():
    for name in list(sys.modules):
        if name == pkg or name.startswith(pkg + "."):
            del sys.modules[name]

# Put this folder first in Python's search list
if path in sys.path:
    sys.path.remove(path)
sys.path.insert(0, path)

key = "cdf_watcher_" + str(ghenv.Component.InstanceGuid)
time_key = key + "_time"
version_key = key + "_version"

def stamp():
    sc.sticky[time_key] = time.strftime("%Y-%m-%d %H:%M:%S")

# Replace the old watcher if the folder changed or the script was updated
old = sc.sticky.get(key)
if old is not None and (os.path.normpath(old.Path) != watch_dir
                        or sc.sticky.get(version_key) != VERSION):
    old.Dispose()
    del sc.sticky[key]
    unload()

if key not in sc.sticky:
    comp = ghenv.Component
    last = [0.0]

    def reload_and_rerun():
        unload()
        stamp()
        doc = comp.OnPingDocument()
        if doc is None:            # reloader was deleted or the file closed
            return
        for obj in doc.Objects:
            if "Python" in obj.GetType().Name:
                obj.ExpireSolution(False)   # mark as out of date
        doc.NewSolution(False)              # recompute once

    def on_change(sender, e):
        if not e.FullPath.endswith(".py") or "__pycache__" in e.FullPath:
            return
        if time.time() - last[0] < 0.5:     # ignore the second event of a double save
            return
        last[0] = time.time()
        Rhino.RhinoApp.InvokeOnUiThread(System.Action(reload_and_rerun))

    w = FileSystemWatcher(watch_dir, "*.py")
    w.IncludeSubdirectories = True
    w.NotifyFilter = NotifyFilters.LastWrite
    w.Changed += on_change
    w.EnableRaisingEvents = True
    sc.sticky[key] = w
    sc.sticky[version_key] = VERSION
    stamp()                                  # time the watcher started

msg = "Last reloaded: {}\nWatching: {}".format(sc.sticky.get(time_key, "unknown"), watch_dir)
print(msg)
out = msg
# ---------- end autoreloader ----------
panel = Panel(autoreloader)

# ----
pt_2 = ConstructPoint(XCoordinate=_0, YCoordinate=_0_2, ZCoordinate=_0_3)

# ---- group: TODO: Build a Parametric Sphere
sphere = Python3Script(x=pt_2, y=radius_sphere)  # -> out, my_sphere
# ---------- sphere: Python ----------
"""Grasshopper Script"""
a = "Hello Python 3 in Grasshopper!"
print(a)

from cdf import create_sphere

my_sphere = create_sphere(center_point=x, radius=y)
# ---------- end sphere ----------

# ---- group: TODO: Make Transformations
transformation = Python3Script(my_sphere=sphere.my_sphere, distance=Slider(1, range=1..10), count=Slider(10, range=1..10))  # -> out, my_spheres; inputs my_sphere: Brep
# ---------- transformation: Python ----------
from cdf import copy_brep_along_z

my_spheres = copy_brep_along_z(my_sphere, distance, count)
# ---------- end transformation ----------

# ---- group: TODO: Make a Boolean Difference
boolean = Python3Script(my_cone=cone.my_cone, my_sphere=sphere.my_sphere)  # -> out, result_geometry; inputs my_cone: Brep, my_sphere: Brep
# ---------- boolean: Python ----------
from cdf import boolean_difference

result_geometry = boolean_difference(my_cone, my_sphere)
# ---------- end boolean ----------

# ---- group: Visualize
preview = CustomPreview(Geometry=cone.my_cone, Material=ColourSwatch(SwatchColor=RGB(60, 230, 88)))

preview_2 = CustomPreview(Geometry=sphere.my_sphere, Material=ColourSwatch(SwatchColor=RGB(255, 86, 88)))

preview_3 = CustomPreview(Geometry=boolean.result_geometry, Material=ColourSwatch(SwatchColor=RGB(255, 86, 255)))

preview_4 = CustomPreview(Geometry=transformation.my_spheres, Material=ColourSwatch(SwatchColor=RGB(255, 255, 96)))
